# Grasshopper definition scan_master_file_ABB_CRB15000.gh (Grasshopper 1.0.8)
# plug-ins: Heteroptera, Human

# ---- group: Scale factor
number_slider = Slider(0.6, range=0..1)

# ---- group: New scan center
number_slider_2 = Slider(-839, range=-1000..1000)
pt = ConstructPoint(
    XCoordinate=Slider(-1000, range=-1200..1000),
    YCoordinate=Slider(200, range=-1000..1000),
    ZCoordinate=Slider(-80, range=-1000..1000))

# ---- group: Old center
pt_2 = Point(<point referenced from the Rhino model>)

# ----
vec2pt = Vector2Pt(PointA=pt_2, PointB=pt, Unitize=False)  # -> Vector, Length
py = PythonScript()  # -> path
# ---------- py: Python ----------
import sys
import os

ghComp = ghenv.Component
ghDoc = ghComp.OnPingDocument()

# the full path of the gh file
path = ghDoc.FilePath
# the current directory 
path = os.path.abspath(os.path.join(path, ".."))

print path
# ---------- end py ----------
md_slider = MDSlider(SliderMode=0, slider_value=Point(0.5, 0.5, 0.5), x_domain=Domain(0, 1), y_domain=Domain(0, 1), z_domain=Domain(0, 1))
srf = Surface(<surface referenced from the Rhino model>)
evalsrf = EvaluateSurface(Surface=reparameterize(srf), Point=md_slider)  # -> Point, Normal, UDirection, VDirection, Frame

# ---- group: Lidar location
pt_3 = Point(<point referenced from the Rhino model>)

# ----
vdis = VectorDisplay(Anchor=evalsrf.Point, Vector=evalsrf.Normal)
pl = PlaneNormal(Origin=evalsrf.Point, ZAxis=evalsrf.Normal)

# ---- group: Phone on holder
mesh = Mesh([<mesh referenced from the Rhino model> x6])

# ----
deplane = DeconstructPlane(Plane=pl)  # -> Origin, XAxis, YAxis, ZAxis

# ---- group: Shift
number_slider_3 = Slider(1, range=0..100)

# ----
panel = Panel("""0
1
-1
-2""")

# ----
# stickies for robot set up
tcp_mm = Panel("0,0,0")
travel_velocity_m_s = Panel("0.02")
acceleration_m_s = Panel(".2")
first_pos_velocity_m_s = Panel("0.02")
blend_radius_m_s = Panel("0.005")
python = GhPythonScript(
    tcp=tcp_mm,
    f_velocity=first_pos_velocity_m_s,
    velocity=travel_velocity_m_s,
    acceleration=acceleration_m_s,
    blend_radius=blend_radius_m_s)  # inputs tcp: Point3d
# ---------- python: Python ----------
import rhinoscriptsyntax as rs
from scriptcontext import sticky as st

st["NAME"] = name
st["TCP"] = tcp
st["FIRST_LAYER_VELOCITY"] = float(f_velocity)
st["TRAVEL_VELOCITY"] = float(velocity)
st["ACCELERATION"] = float(acceleration)
st["BLEND_RADIUS"] = float(blend_radius)
# ---------- end python ----------

file_send = Button()

# ----
# old planning code without safe poses and other adjusments
button = Button()
python_2 = GhPythonScript(send=button)  # -> out, a
# ---------- python_2: Python ----------
import sys
import os

# Get the directory of the Grasshopper file and add it to sys.path
gh_file_dir = os.path.dirname(ghenv.Component.OnPingDocument().FilePath)
if gh_file_dir not in sys.path:
    sys.path.append(gh_file_dir)

# Import the modules
import simple_comm as c
import simple_ur_script as ur

# Generate the script
script = ""
script += "def program():\n"
script += "    stopl(2.0)\n"  # Add a stop command with deceleration
script += "end\n"

# Print the script to verify formatting
print(script)

# Send the script to the robot if `send` is True
if send:
    c.send_script(script.encode('utf-8'), "192.168.10.10")
# ---------- end python_2 ----------

# ----
# 3 scanning trajectories
crv = Curve(<curve referenced from the Rhino model>)
crv_2 = Curve(<curve referenced from the Rhino model>)
crv_3 = Curve(<curve referenced from the Rhino model>)
number_slider_4 = Slider(50, range=0..100)

# ---- group: Scale down
center = Center(Geometry=crv_2)  # -> Center, Dimension
center_2 = Center(Geometry=crv)  # -> Center, Dimension
center_3 = Center(Geometry=crv_3)  # -> Center, Dimension
scale = Scale(Geometry=crv_2, Center=center.Center, Factor=number_slider)  # -> Geometry, Transform
scale_2 = Scale(Geometry=crv, Center=center_2.Center, Factor=number_slider)  # -> Geometry, Transform
scale_3 = Scale(Geometry=crv_3, Center=center_3.Center, Factor=number_slider)  # -> Geometry, Transform

# ----
flip = FlipCurve(Curve=scale_2.Geometry)  # -> Curve, Flag

# ---- group: Move to scanning center
move = Move(Geometry=scale.Geometry, Motion=vec2pt.Vector)  # -> Geometry, Transform
move_2 = Move(Geometry=flip.Curve, Motion=vec2pt.Vector)  # -> Geometry, Transform
move_3 = Move(Geometry=scale_3.Geometry, Motion=vec2pt.Vector)  # -> Geometry, Transform

# ----
merge = Merge(Data1=move.Geometry, Data2=move_2.Geometry, Data3=move_3.Geometry)
divide = DivideCurve(Curve=merge, Count=number_slider_4, Kinks=False)  # -> Points, Tangents, Parameters

vec2pt_2 = Vector2Pt(PointA=divide.Points, PointB=pt, Unitize=False)  # -> Vector, Length
deplane_2 = DeconstructPlane(Plane=divide.Points)  # -> Origin, XAxis, YAxis, ZAxis
pl_2 = ConstructPlane(Origin=divide.Points, XAxis=vec2pt_2.Vector, YAxis=deplane_2.ZAxis)
vdis_2 = VectorDisplay(Anchor=divide.Points, Vector=vec2pt_2.Vector)

deplane_3 = DeconstructPlane(Plane=pl_2)  # -> Origin, XAxis, YAxis, ZAxis

# ----
# phone viz on trajectory path
mesh_2 = Mesh(<mesh referenced from the Rhino model>)
bbox = BoundingBox(Content=mesh_2, Plane=PlaneXY(0, 0, 0))  # -> Box, Box_2
debrep = DeconstructBrep(Brep=bbox.Box)  # -> Faces, Edges, Vertices
mjoin = MeshJoin(Meshes=mesh)
item = ListItem(List=debrep.Faces, Index=Slider(4, range=0..10), Wrap=True)

# ---- group: Plane transformation
python_3 = GhPythonScript(
    geometries=[item, mjoin],
    source_origin=pt_3,
    source_z=evalsrf.Normal,
    source_x=deplane.XAxis,
    target_origins=deplane_3.Origin,
    target_zs=deplane_3.XAxis,
    target_xs=deplane_3.ZAxis)  # -> out, a; inputs geometries: list of Mesh, source_origin: Point3d, source_z: Vector3d, source_x: Vector3d, target_origins: list of Point3d, target_zs: list of Vector3d, target_xs: list of Vector3d
# ---------- python_3: Python ----------
import Rhino.Geometry as rg

# Input parameters (these should be plugged into the Python component in Grasshopper):
# - geometries: List of Rhino geometries to orient
# - source_origin: Point3d, origin of the source plane
# - source_z: Vector3d, Z-axis of the source plane
# - source_x: Vector3d, X-axis of the source plane
# - target_origins: List of Point3d, target plane origins
# - target_zs: List of Vector3d, target plane Z-axes
# - target_xs: List of Vector3d, target plane X-axes

# Create the source plane
source_plane = rg.Plane(source_origin, source_x, source_z)

# List to store transformed geometries
transformed_geometries = []

# Iterate over the target origins, Zs, and Xs
for target_origin, target_z, target_x in zip(target_origins, target_zs, target_xs):
    # Ensure target Z and X are orthogonal
    target_z.Unitize()
    target_x = rg.Vector3d.CrossProduct(target_z, rg.Vector3d.CrossProduct(target_x, target_z))
    target_x.Unitize()
    
    # Construct the target plane
    target_plane = rg.Plane(target_origin, target_x, target_z)
    
    # Create the transformation from the source plane to the target plane
    transformation = rg.Transform.PlaneToPlane(source_plane, target_plane)
    
    # Transform each geometry in the list
    for geometry in geometries:
        # Create a copy of the geometry to transform
        transformed_geometry = geometry.Duplicate()
        transformed_geometry.Transform(transformation)
        transformed_geometries.append(transformed_geometry)

# Output the list of transformed geometries
a = transformed_geometries
# ---------- end python_3 ----------

# ----
python_4 = GhPythonScript(
    geometry=item,
    source_origin=pt_3,
    source_z=evalsrf.Normal,
    source_x=deplane.XAxis,
    target_origins=deplane_3.Origin,
    target_zs=deplane_3.XAxis,
    target_xs=deplane_3.ZAxis)  # -> out, a; inputs geometry: Mesh, source_origin: Point3d, source_z: Vector3d, source_x: Vector3d, target_origins: list of Point3d, target_zs: list of Vector3d, target_xs: list of Vector3d
# ---------- python_4: Python ----------
import Rhino.Geometry as rg

# Input parameters (these should be plugged into the Python component in Grasshopper):
# - geometries: List of Rhino geometries to orient
# - source_origin: Point3d, origin of the source plane
# - source_z: Vector3d, Z-axis of the source plane
# - source_x: Vector3d, X-axis of the source plane
# - target_origins: List of Point3d, target plane origins
# - target_zs: List of Vector3d, target plane Z-axes
# - target_xs: List of Vector3d, target plane X-axes

# Create the source plane
source_plane = rg.Plane(source_origin, source_x, source_z)

# List to store transformed geometries
transformed_geometries = []

# Iterate over the target origins, Zs, and Xs
for target_origin, target_z, target_x in zip(target_origins, target_zs, target_xs):
    # Ensure target Z and X are orthogonal
    target_z.Unitize()
    target_x = rg.Vector3d.CrossProduct(target_z, rg.Vector3d.CrossProduct(target_x, target_z))
    target_x.Unitize()
    
    # Construct the target plane
    target_plane = rg.Plane(target_origin, target_x, target_z)
    
    # Create the transformation from the source plane to the target plane
    transformation = rg.Transform.PlaneToPlane(source_plane, target_plane)
    
    
    # Create a copy of the geometry to transform
    transformed_geometry = geometry.Duplicate()
    transformed_geometry.Transform(transformation)
    transformed_geometries.append(transformed_geometry)

# Output the list of transformed geometries
a = transformed_geometries
# ---------- end python_4 ----------

item_2 = ListItem(List=python_3.a, Index=0, Wrap=True)
preview = CustomPreview(Geometry=item_2, Material=ColourSwatch(SwatchColor=RGB(255, 254, 254)))

split = SplitList(List=python_4.a, Index=number_slider_4)  # -> ListA, ListB

# ---- group: Transformed trajectory planes
facen = FaceNormals(Mesh=flatten(python_4.a))  # -> Centers, Normals
neg = Negative(Value=facen.Normals)
eval = EvaluateCurve(Curve=graft(merge), Parameter=divide.Parameters)  # -> Point, Tangent, Angle

# ----
pt_4 = Point(facen.Centers)
vec = Vector(neg)

# ---- group: Transformed trajectory planes (continued)
xprod = CrossProduct(VectorA=flatten(vec), VectorB=flatten(eval.Tangent), Unitize=False)  # -> Vector, Length
pl_3 = ConstructPlane(Origin=flatten(pt_4), XAxis=flatten(eval.Tangent), YAxis=xprod.Vector)

# ----
rot3d = Rotate3D(Geometry=pl_3, Angle=degrees(Slider(45, range=0..100)), Center=flatten(pt_4), Axis=flatten(facen.Normals))  # -> Geometry, Transform
partition = PartitionList(List=rot3d.Geometry, Size=number_slider_4)  # -> simplify(Chunks)

# ---- group: Shift trajectory start
branch = TreeBranch(Tree=partition, Path="0", MaintainPaths=True)
branch_2 = TreeBranch(Tree=partition, Path="1", MaintainPaths=True)
branch_3 = TreeBranch(Tree=partition, Path="2", MaintainPaths=True)
neg_2 = Negative(Value=number_slider_3)
shift = ShiftList(List=branch_3, Shift=number_slider_3, Wrap=True)
shift_2 = ShiftList(List=branch, Shift=number_slider_3, Wrap=True)

# ---- group: Rotation for flipped curve
deplane_4 = DeconstructPlane(Plane=branch_2)  # -> Origin, XAxis, YAxis, ZAxis
rot3d_2 = Rotate3D(
    Geometry=branch_2,
    Angle=degrees(Slider(180, range=0..180)),
    Center=flatten(deplane_4.Origin),
    Axis=flatten(deplane_4.ZAxis))  # -> Geometry, Transform

# ----
cull_i = CullIndex(List=shift, Indices=panel, Wrap=True)
cull_i_2 = CullIndex(List=shift_2, Indices=panel, Wrap=True)

# ---- group: Shift trajectory start (continued)
shift_3 = ShiftList(List=rot3d_2.Geometry, Shift=neg_2, Wrap=True)

# ----
cull_i_3 = CullIndex(List=shift_3, Indices=panel, Wrap=True)

# ---- group: Shift trajectory start (continued)
merge_2 = Merge(Data1=cull_i_2, Data2=cull_i_3, Data3=cull_i)

# ----
# target planes
pln = Plane(merge_2)

pline = PolyLine(Vertices=flatten(pln), Closed=False)
curvepoint = PointOnCurve(pline, parameter=0)

# ---- group: Save to json
py3 = Python3Script(save=Button(), planes=flatten(pln), filename="planes.json", path=py)  # -> out; inputs save: Boolean, planes: list of Plane, filename: String, path: String
# ---------- py3: Python ----------
import compas
import os, json

# from compas.geometry import Point, Vector, Plane

# # Convert Rhino/GH plane to COMPAS plane
# def gh_to_compas_plane(gh_plane):
#     origin = gh_plane.Origin
#     normal = gh_plane.ZAxis
#     p = Plane(Point(origin.X, origin.Y, origin.Z), Vector(normal.X, normal.Y, normal.Z))
#     print(p)
#     return p

# # Convert all input planes
# compas_planes = [gh_to_compas_plane(p) for p in planes]

planes_dict = {}
for i, gh_plane in enumerate(planes):
    origin = gh_plane.Origin
    xvec = gh_plane.XAxis
    yvec = gh_plane.YAxis
    planes_dict[i] = {
        "Point": [origin.X, origin.Y, origin.Z],
        "X": [xvec.X, xvec.Y, xvec.Z],
        "Y": [yvec.X, yvec.Y, yvec.Z]
    }

if save:
    with open(os.path.join(path, filename), 'w') as f:
        json.dump(planes_dict, f, indent=2)
        print("Saved to: ", os.path.join(path, filename))
# ---------- end py3 ----------
panel_2 = Panel(py3)

# ----
sph = Sphere(Base=curvepoint, Radius=Slider(36, range=0..100))

pline_2 = PolyLine(Vertices=pln, Closed=False)
# target path and plane viz
colour_swatch = ColourSwatch(SwatchColor=RGB(234, 210, 0))
preview_2 = CustomPreview(Geometry=pln, Shader=colour_swatch)
previewlw = CustomPreviewLineweights(Geometry=pline_2, Shader=ColourSwatch(SwatchColor=RGB(56, 189, 255)), Thickness=4, Absolute=False)

save_json = Button()
# send empty script for pausing
file_send_2 = Button()
python_5 = GhPythonScript(PlanesTree=pln, save_json=save_json, send=file_send_2)  # -> out, script; inputs PlanesTree: tree of Plane, send: Boolean
# ---------- python_5: Python ----------
def ghtree_to_list_single_level(tree):
    """Returns a Python list of lists, 
    one sub-list per branch in the Grasshopper data tree."""
    result = []
    for i in range(tree.BranchCount):
        branch = tree.Branch(i)   # This gives the planes for branch i
        result.append(list(branch))
    return result

planes_tree = ghtree_to_list_single_level(PlanesTree)

import sys
import os
import imp
import math

# Ensure the directory containing simple_ur_script is in sys.path
gh_file_dir = os.path.dirname(ghenv.Component.OnPingDocument().FilePath)
if gh_file_dir not in sys.path:
    sys.path.append(gh_file_dir)

# Unload and reload the simple_ur_script module
try:
    if "simple_ur_script" in sys.modules:
        imp.reload(sys.modules["simple_ur_script"])
    else:
        import simple_ur_script
except Exception as e:
    print("Error reloading simple_ur_script: {}".format(e))

# Now import the updated module
import simple_ur_script as ur
import simple_comm as c
import json
import Rhino.Geometry as rg
import math as m
from compas.geometry import Frame
from scriptcontext import sticky as st

# JSON Path
json_path = os.path.abspath(os.path.join(st["FOLDER_PATH"], "../..", "data", "json", st["NAME"]))

# Flatten them to estimate total path length for “time left” messages, but keep them grouped
all_planes_flat = []
for orbit_planes in planes_tree:
    all_planes_flat.extend(orbit_planes)

pts = [pl.Origin for pl in all_planes_flat]
poly_c = rg.PolylineCurve(pts)
esti_time = poly_c.GetLength() / float(st["TRAVEL_VELOCITY"])

if send:
    script_list = []
    
    # 1. Define the URScript program
    header = "def my_script():\n"
    script_list.append(header)
    
    # 2. Set TCP
    script_list.append(
        ur.set_tcp_by_angles(
            st["TCP"][0], 
            st["TCP"][1], 
            st["TCP"][2], 
            m.radians(-90.0), 
            m.radians(0.0), 
            m.radians(-90.0)
        )
    )
    
    # 2.5. [NEW] Move to a known safe start pose via joint move
    # Example safe_joints in radians (adjust these to your actual angles)
    safe_joints_degs = [-0.42, -38.68, -158.60, -39.23, 74.08, 293.25]
    safe_joints_rads = [math.radians(d) for d in safe_joints_degs]

    script_list.append(
    ur.move_j(
        safe_joints_rads,
        1.0,   # A bigger acceleration
        1.0    # A bigger velocity
    )
)

    # 3. Wait times before first orbit
    script_list.append(ur.sleep(5.0))   # 5s pause (simulating "Continue")
    script_list.append(ur.sleep(12.0))  # 12s pause (simulating "Start capture")

    # 4. Loop over orbits
    for orbit_index, orbit_planes in enumerate(planes_tree):
        for i, pl in enumerate(orbit_planes):
            if (i == 0 and orbit_index == 0):
                # First move: use FIRST_LAYER_VELOCITY
                script_list.append(
                    ur.move_l_blend(
                        pl,
                        st["ACCELERATION"],
                        st["FIRST_LAYER_VELOCITY"],
                        st["BLEND_RADIUS"]
                    )
                )
            else:
                script_list.append(
                    ur.move_l_blend(
                        pl,
                        st["ACCELERATION"],
                        st["TRAVEL_VELOCITY"],
                        st["BLEND_RADIUS"]
                    )
                )

            # Log progress
            percent_done = (i + sum(len(o) for o in planes_tree[:orbit_index])) / float(len(all_planes_flat)) * 100
            script_list.append(ur.textmsg("Estimate time is ", esti_time))
            script_list.append(ur.textmsg(int(percent_done), "% of path is done"))
        
        # 5. Between orbits: extra waits for "Continue / Can't Flip / Continue"
        if orbit_index < len(planes_tree) - 1:
            script_list.append(ur.sleep(5.0))
            script_list.append(ur.sleep(8.0))
            script_list.append(ur.sleep(5.0))
    
    # 6. End definition
    script_list.append("end\n")
    script_list.append("\nmy_script()\n")

    final_script = "".join(script_list)
    c.send_script(final_script, "192.168.10.10")


# 2) Optionally Save as JSON
if save_json:
    data = {}
    idx = 0
    for orbit_index, orbit_planes in enumerate(planes_tree):
        for pl in orbit_planes:
            data[idx] = {
                "plane": {
                    "point": [pl.OriginX, pl.OriginY, pl.OriginZ],
                    "xAxis": [1.0, 0.0, 0.0],
                    "yAxis": [0.0, 1.0, 0.0]
                },
                "TRAVEL_VELOCITY": st["TRAVEL_VELOCITY"],
                "BLEND_RADIUS": st["BLEND_RADIUS"],
                "orbitIndex": orbit_index
            }
            idx += 1
    
    with open(json_path, "w") as f:
        f.write(json.dumps(data, indent=3, sort_keys=True))
# ---------- end python_5 ----------
panel_3 = Panel(python_5.out)

file_send_3 = Button()
file_send_4 = Button()
python_6 = GhPythonScript(PlanesTree=pln, send=file_send)  # -> out, script; inputs PlanesTree: tree of Plane, send: Boolean
# ---------- python_6: Python ----------
def ghtree_to_list_single_level(tree):
    """Returns a Python list of lists, 
    one sub-list per branch in the Grasshopper data tree."""
    result = []
    for i in range(tree.BranchCount):
        branch = tree.Branch(i)   # This gives the planes for branch i
        result.append(list(branch))
    return result

planes_tree = ghtree_to_list_single_level(PlanesTree)

import sys
import os
import imp

# Ensure the directory containing simple_ur_script is in sys.path
gh_file_dir = os.path.dirname(ghenv.Component.OnPingDocument().FilePath)
if gh_file_dir not in sys.path:
    sys.path.append(gh_file_dir)

# Unload and reload the simple_ur_script module
try:
    if "simple_ur_script" in sys.modules:
        imp.reload(sys.modules["simple_ur_script"])
    else:
        import simple_ur_script
except Exception as e:
    print("Error reloading simple_ur_script: {}".format(e))

# Now import the updated module
import simple_ur_script as ur
import simple_comm as c
import json
import Rhino.Geometry as rg
import math as m
from compas.geometry import Frame
from scriptcontext import sticky as st

# JSON Path
json_path = os.path.abspath(os.path.join(st["FOLDER_PATH"], "../..", "data", "json", st["NAME"]))

# EXAMPLE:
# planes_tree is a list of lists, where planes_tree[0] = [Plane1, Plane2, ...] for orbit 1
# planes_tree[1] = [Plane1, Plane2, ...] for orbit 2, etc.
# In Grasshopper, this means you have a data tree with 3 branches, each branch ~ a single orbit.

# Flatten them to estimate total path length for “time left” messages, but keep them grouped
all_planes_flat = []
for orbit_planes in planes_tree:
    all_planes_flat.extend(orbit_planes)

pts = [pl.Origin for pl in all_planes_flat]
poly_c = rg.PolylineCurve(pts)
esti_time = poly_c.GetLength() / float(st["TRAVEL_VELOCITY"])

# ------------------------------------------------
# 1) Construct and send UR script
# ------------------------------------------------
if send:
    # Start building a single large URScript in a string.
    script_list = []
    
    # 1. Define the function or top-level program
    #    We’ll nest everything inside `def testPrint(): ... end`
    #    so that we can call it after definition.
    header = "def my_script():\n"
    script_list.append(header)
    
    # 2. Set your TCP
    script_list.append(
        ur.set_tcp_by_angles(
            st["TCP"][0], 
            st["TCP"][1], 
            st["TCP"][2], 
            m.radians(-90.0), 
            m.radians(0.0), 
            m.radians(-90.0)
        )
    )
    
    # 3. WAIT times before first orbit
    #    - 5 seconds “Continue”  
    #    - 12 seconds “Start capturing”
    script_list.append(ur.sleep(5.0))   # 5s pause
    script_list.append(ur.sleep(12.0))  # 12s pause

    # 4. Loop over each orbit in the tree
    for orbit_index, orbit_planes in enumerate(planes_tree):
        # Move commands for each orbit
        for i, pl in enumerate(orbit_planes):
            # If this is the very first move in the entire orbit set, go slower
            if (i == 0 and orbit_index == 0):
                # Example: first move uses FIRST_LAYER_VELOCITY
                script_list.append(
                    ur.move_l_blend(
                        pl,
                        st["ACCELERATION"],
                        st["FIRST_LAYER_VELOCITY"],
                        st["BLEND_RADIUS"]
                    )
                )
            else:
                # Normal travel velocity
                script_list.append(
                    ur.move_l_blend(
                        pl,
                        st["ACCELERATION"],
                        st["TRAVEL_VELOCITY"],
                        st["BLEND_RADIUS"]
                    )
                )

            # Log progress
            percent_done = (i + sum(len(o) for o in planes_tree[:orbit_index])) / float(len(all_planes_flat)) * 100
            script_list.append(ur.textmsg("Estimate time is ", esti_time))
            script_list.append(ur.textmsg(int(percent_done), "% of path is done"))
        
        # 5. If NOT the last orbit, insert the wait times for “Continue / Can’t Flip / Continue”
        if orbit_index < len(planes_tree) - 1:
            # e.g. 3s for "Continue," 3s for "Can't Flip," 3s for next "Continue" 
            # Adjust as needed
            script_list.append(ur.sleep(5.0))
            script_list.append(ur.sleep(8.0))
            script_list.append(ur.sleep(5.0))
    
    # 6. End the URScript definition
    script_list.append("end\n")  # closes “def my_script()”
    # 7. After definition, call the script
    script_list.append("\nmy_script()\n")

    # 8. Concatenate and send
    final_script = "".join(script_list)         # or use c.concatenate_script("", script_list)
    c.send_script(final_script, "192.168.10.10")

# ------------------------------------------------
# 2) Optionally Save as JSON
# ------------------------------------------------
if save_json:
    data = {}
    idx = 0
    for orbit_index, orbit_planes in enumerate(planes_tree):
        for pl in orbit_planes:
            data[idx] = {
                "plane": {
                    "point": [pl.OriginX, pl.OriginY, pl.OriginZ],
                    "xAxis": [1.0, 0.0, 0.0],
                    "yAxis": [0.0, 1.0, 0.0]
                },
                "TRAVEL_VELOCITY": st["TRAVEL_VELOCITY"],
                "BLEND_RADIUS": st["BLEND_RADIUS"],
                "orbitIndex": orbit_index
            }
            idx += 1
    
    with open(json_path, "w") as f:
        f.write(json.dumps(data, indent=3, sort_keys=True))
# ---------- end python_6 ----------
python_7 = GhPythonScript(PlanesTree=pln, send=file_send_4)  # -> out, script; inputs PlanesTree: tree of Plane, send: Boolean
# ---------- python_7: Python ----------
def ghtree_to_list_single_level(tree):
    """Returns a Python list of lists,
    one sub-list per branch in the Grasshopper data tree."""
    result = []
    for i in range(tree.BranchCount):
        branch = tree.Branch(i)
        result.append(list(branch))
    return result

planes_tree = ghtree_to_list_single_level(PlanesTree)

import sys
import os
import imp
import math

# Ensure the directory containing simple_ur_script is in sys.path
gh_file_dir = os.path.dirname(ghenv.Component.OnPingDocument().FilePath)
if gh_file_dir not in sys.path:
    sys.path.append(gh_file_dir)

# Reload or import simple_ur_script
try:
    if "simple_ur_script" in sys.modules:
        imp.reload(sys.modules["simple_ur_script"])
    else:
        import simple_ur_script
except Exception as e:
    print("Error reloading simple_ur_script: {}".format(e))

import simple_ur_script as ur
import simple_comm as c
import json
import Rhino.Geometry as rg
import math as m
from compas.geometry import Frame
from scriptcontext import sticky as st

# JSON Path
json_path = os.path.abspath(os.path.join(st["FOLDER_PATH"], "../..", "data", "json", st["NAME"]))

# Flatten all planes just for length/esti_time calculation
all_planes_flat = []
for orbit_planes in planes_tree:
    all_planes_flat.extend(orbit_planes)

pts = [pl.Origin for pl in all_planes_flat]
poly_c = rg.PolylineCurve(pts)
esti_time = poly_c.GetLength() / float(st["TRAVEL_VELOCITY"])

# Example safe poses in degrees (one for each orbit).
# [Base, Shoulder, Elbow, Wrist1, Wrist2, Wrist3]
safe_poses_degs = [
    [  0.76, -51.68, -156.12, -29.22,  72.83, 294.96],  # orbit 0
    [  3.68, -82.03, -159.32,   4.82,  65.14, -80.0],  # orbit 1
    [ -0.37, -54.02, -155.57, -26.92,  73.89, 293.27],  # orbit 2
]

if send:
    script_list = []
    
    # Start URScript
    script_list.append("def my_script():\n")

    # 1) Set TCP
    script_list.append(
        ur.set_tcp_by_angles(
            st["TCP"][0],
            st["TCP"][1],
            st["TCP"][2],
            math.radians(-90.0),
            math.radians(0.0),
            math.radians(-90.0)
        )
    )

    # 2) Move to the safe pose for the FIRST orbit right away
    #    (This is outside the loop, so the robot is in correct position
    #     before orbit 0 scanning.)
    first_pose_rads = [math.radians(d) for d in safe_poses_degs[0]]
    script_list.append(
        ur.move_j(
            first_pose_rads,
            1.0,  # acceleration
            1.0   # velocity
        )
    )

    # Now go through each orbit in planes_tree
    for orbit_index in range(len(planes_tree)):

        # A) Wait for bounding box detection, or "Start Capture" etc.
        #    This is a per-orbit wait if you want it. Adjust as needed.
        #    e.g. 15s bounding box time:
        script_list.append(ur.sleep(15.0))

        # B) Perform scanning moves for THIS orbit
        orbit_planes = planes_tree[orbit_index]
        for i, pl in enumerate(orbit_planes):
            if orbit_index == 0 and i == 0:
                # first move of first orbit => special speed
                script_list.append(
                    ur.move_l_blend(
                        pl,
                        st["ACCELERATION"],
                        st["FIRST_LAYER_VELOCITY"],
                        st["BLEND_RADIUS"]
                    )
                )
            else:
                # normal travel velocity
                script_list.append(
                    ur.move_l_blend(
                        pl,
                        st["ACCELERATION"],
                        st["TRAVEL_VELOCITY"],
                        st["BLEND_RADIUS"]
                    )
                )

            # Log progress
            done = (i + sum(len(o) for o in planes_tree[:orbit_index]))
            total = float(len(all_planes_flat))
            percent_done = (done / total) * 100

            script_list.append(ur.textmsg("Estimate time is ", esti_time))
            script_list.append(ur.textmsg(int(percent_done), "% of path is done"))

        # C) If NOT the last orbit, jump to the NEXT orbit's safe pose
        #    THEN wait 11s for "Continue → Can't Flip → Continue"
        if orbit_index < len(planes_tree) - 1:
            next_pose_degs = safe_poses_degs[orbit_index + 1]
            next_pose_rads = [math.radians(d) for d in next_pose_degs]

            # move immediately to next orbit's safe pose
            script_list.append(
                ur.move_j(
                    next_pose_rads,
                    1.0,  # acceleration
                    1.0   # velocity
                )
            )

            # Now wait 11s so iOS can do "Continue -> Can't Flip -> Continue"
            script_list.append(ur.textmsg("Between orbit {0} and {1} - waiting 11s".format(
                orbit_index, orbit_index + 1
            ), ""))

            script_list.append(ur.sleep(11.0))

    # End the URScript definition
    script_list.append("end\n")
    script_list.append("\nmy_script()\n")

    # Concatenate and send
    final_script = "".join(script_list)
    c.send_script(final_script, "192.168.10.10")


# Optionally Save JSON
if save_json:
    data = {}
    idx = 0
    for orbit_index, orbit_planes in enumerate(planes_tree):
        for pl in orbit_planes:
            data[idx] = {
                "plane": {
                    "point": [pl.OriginX, pl.OriginY, pl.OriginZ],
                    "xAxis": [1.0, 0.0, 0.0],
                    "yAxis": [0.0, 1.0, 0.0]
                },
                "TRAVEL_VELOCITY": st["TRAVEL_VELOCITY"],
                "BLEND_RADIUS": st["BLEND_RADIUS"],
                "orbitIndex": orbit_index
            }
            idx += 1
    
    with open(json_path, "w") as f:
        f.write(json.dumps(data, indent=3, sort_keys=True))
# ---------- end python_7 ----------
python_8 = GhPythonScript(PlanesTree=pln, send=file_send_3)  # -> out, script; inputs PlanesTree: tree of Plane, send: Boolean
# ---------- python_8: Python ----------
def ghtree_to_list_single_level(tree):
    """Returns a Python list of lists, 
    one sub-list per branch in the Grasshopper data tree."""
    result = []
    for i in range(tree.BranchCount):
        branch = tree.Branch(i)   # This gives the planes for branch i
        result.append(list(branch))
    return result

planes_tree = ghtree_to_list_single_level(PlanesTree)

import sys
import os
import imp
import math

# Ensure the directory containing simple_ur_script is in sys.path
gh_file_dir = os.path.dirname(ghenv.Component.OnPingDocument().FilePath)
if gh_file_dir not in sys.path:
    sys.path.append(gh_file_dir)

try:
    if "simple_ur_script" in sys.modules:
        imp.reload(sys.modules["simple_ur_script"])
    else:
        import simple_ur_script
except Exception as e:
    print("Error reloading simple_ur_script: {}".format(e))

import simple_ur_script as ur
import simple_comm as c
import json
import Rhino.Geometry as rg
import math as m
from compas.geometry import Frame
from scriptcontext import sticky as st

json_path = os.path.abspath(os.path.join(st["FOLDER_PATH"], "../..", "data", "json", st["NAME"]))

all_planes_flat = []
for orbit_planes in planes_tree:
    all_planes_flat.extend(orbit_planes)

pts = [pl.Origin for pl in all_planes_flat]
poly_c = rg.PolylineCurve(pts)
esti_time = poly_c.GetLength() / float(st["TRAVEL_VELOCITY"])

# 1) Define a safe-pose list of lists, 
#    where each sub-list = [BaseDeg, ShoulderDeg, ElbowDeg, Wrist1Deg, Wrist2Deg, Wrist3Deg]
#    in degrees:
safe_poses_degs = [
    [0.76,  -51.68, -156.12, -29.22, 72.83,  294.96],  # orbit 0
    [ 3.68,  -82.03, -159.32,   4.82, 65.14,  302.60],  # orbit 1
    [-0.37,  -54.02, -155.57, -26.92, 73.89,  293.27]   # orbit 2
]

if send:
    script_list = []
    
    # Start URScript
    header = "def my_script():\n"
    script_list.append(header)

    # Set TCP
    script_list.append(
        ur.set_tcp_by_angles(
            st["TCP"][0], 
            st["TCP"][1], 
            st["TCP"][2], 
            math.radians(-90.0), 
            math.radians(0.0), 
            math.radians(-90.0)
        )
    )

    # OPTIONAL: Some initial wait or pose, if desired
    # script_list.append(ur.sleep(2.0))

    # 2) For each orbit:
    for orbit_index, orbit_planes in enumerate(planes_tree):

        # A) Move to the orbit's safe pose
        #    Convert from degrees -> radians for move_j
        pose_degs = safe_poses_degs[orbit_index]
        pose_rads = [math.radians(d) for d in pose_degs]

        script_list.append(
            ur.move_j(
                pose_rads,
                1.0,  # acceleration
                1.0   # velocity
            )
        )

        # B) Wait a bit if you like (simulate "Continue"/"Start")
        #    This is optional or could be replaced with the times you want
        script_list.append(ur.sleep(15.0))

        # C) Perform the linear moves for THIS orbit
        for i, pl in enumerate(orbit_planes):
            if (orbit_index == 0 and i == 0):
                # first move of first orbit => special speed
                script_list.append(
                    ur.move_l_blend(
                        pl,
                        st["ACCELERATION"],
                        st["FIRST_LAYER_VELOCITY"],
                        st["BLEND_RADIUS"]
                    )
                )
            else:
                script_list.append(
                    ur.move_l_blend(
                        pl,
                        st["ACCELERATION"],
                        st["TRAVEL_VELOCITY"],
                        st["BLEND_RADIUS"]
                    )
                )

            # Log progress
            done = (i + sum(len(o) for o in planes_tree[:orbit_index]))
            total = float(len(all_planes_flat))
            percent_done = (done / total) * 100

            script_list.append(ur.textmsg("Estimate time is ", esti_time))
            script_list.append(ur.textmsg(int(percent_done), "% of path is done"))

        # If you want some "Between Orbits" wait time:
        # (You can skip if orbit_index == len(planes_tree)-1, i.e. last orbit)
        if orbit_index < len(planes_tree) - 1:
            script_list.append(
                ur.textmsg("Waiting between orbits {0} and {1}".format(orbit_index, orbit_index + 1), ""))
            script_list.append(ur.sleep(11.0))  # "Continue", "Can't Flip", "Continue"

    # End the script
    script_list.append("end\n")
    script_list.append("\nmy_script()\n")

    final_script = "".join(script_list)
    c.send_script(final_script, "192.168.10.10")


# Optionally Save JSON
if save_json:
    data = {}
    idx = 0
    for orbit_index, orbit_planes in enumerate(planes_tree):
        for pl in orbit_planes:
            data[idx] = {
                "plane": {
                    "point": [pl.OriginX, pl.OriginY, pl.OriginZ],
                    "xAxis": [1.0, 0.0, 0.0],
                    "yAxis": [0.0, 1.0, 0.0]
                },
                "TRAVEL_VELOCITY": st["TRAVEL_VELOCITY"],
                "BLEND_RADIUS": st["BLEND_RADIUS"],
                "orbitIndex": orbit_index
            }
            idx += 1
    
    with open(json_path, "w") as f:
        f.write(json.dumps(data, indent=3, sort_keys=True))
# ---------- end python_8 ----------
